# Dynamo graph DynamoInventor-Vase-Preview.dyn (Dynamo 4.2.1.5887)
# Original four-circle vase loft, prepared for DynamoInventor 4.2. Preview only: this graph creates no Inventor model objects. All lengths are cm; default height 15 cm / 150 mm. Sections are at 0%, 30%, 70% and 100% of height. Open surface, no bottom or wall thickness.

bottom_radius_cm = DoubleSlider(0.9, range=0.1..15 step 0.1)  # graph input
byCenterPointRadius = Circle.ByCenterPointRadius(radius=bottom_radius_cm)
circle_2_radius_cm = DoubleSlider(3.1, range=0.1..15 step 0.1)  # graph input
byCenterPointRadius_2 = Circle.ByCenterPointRadius(radius=circle_2_radius_cm)
height_cm = DoubleSlider(15, range=0.1..20 step 0.1)  # graph input
code_block = CodeBlock(x=height_cm) { x*0.3; x*0.7; x; }
translate = Geometry.Translate(geometry=byCenterPointRadius_2, zTranslation=code_block.out0)
circle_3_radius_cm = DoubleSlider(1.3, range=0.1..15 step 0.1)  # graph input
byCenterPointRadius_3 = Circle.ByCenterPointRadius(radius=circle_3_radius_cm)
translate_2 = Geometry.Translate(geometry=byCenterPointRadius_3, zTranslation=code_block.out1)
top_radius_cm = DoubleSlider(1.4, range=0.1..15 step 0.1)  # graph input
byCenterPointRadius_4 = Circle.ByCenterPointRadius(radius=top_radius_cm)
translate_3 = Geometry.Translate(geometry=byCenterPointRadius_4, zTranslation=code_block.x)
create = List.Create(item0=byCenterPointRadius, item1=translate, item2=translate_2, item3=translate_3)
byLoft = Surface.ByLoft(crossSections=create)
